# Dynamo graph Adicionar_parametro_compartilhado_em_familias.dyn "Adicionar_parametro_compartilhado_em_familia-2" (Dynamo 2.17.0.3472)
# Adiciona Parâmetros Compartilhados em famílias

# group: Adicionar parâmetros compartilhados em famílias
# note: Esta rotina foi derivada de outra mais antiga que usava uma planilha do excel com campos necessários a sua criação original bem mais flexível do que a atrual.
# Alguns nodes da rotina antiga se tornaram obsoletos e não estão mais disponíveis nos pacotes atuais.
# Esta rotina atual é uma simplificação da original que previa a criação de :
# •  Nome dos parâmetros
# •  Nome do Grupo de cada parâmetro
# •  SpecTypede cada parâmetro
# •  GroupType de cada parâmetro
# •  Se o parâmetro é de tipo ou instância
# •  Se o parâmetro é de relatório/listagem
# Esta rotina prevê a criação de  :
# •  Nome do parâmetro
# •  Nome do Grupo único ou distinto
# •  SpecType única
# •  GroupType único
# •  Se parâmetro de tipo ou instância
# Entretanto :
# •  O nome do Grupo dos parâmetros pode ser único ou individualmente defininido em cada linha da planilha do excel (O usuário precisa definir ao executar a rotina e especificar o seu nome único, se assim o desejar).
# •  SpecType único para todos os parâmetros a ser difinido antes da execução da rotina
# •  GrpoupType único para todos os parâmetros a ser definido antes da execuçcão da rotina
# Para se criar GroupTypes e SpecTypes distintas, execute a rotina mais de uma vez alterando estes valores e criando outras variáveis correpondentes na planilha do excel.
# note: Esta rotina tem como objetivo criar parâmetros compartilhados que poderão serão utilizados especificamente na geração de relatórios quantitativos a serem preenchidos a partir da execução de rotinas Dynamo levando-se em cosideração os seus nomes específicos.
# Se fossem usados parâmetros já existentes nos templates, os relatórios precisariam ser gerados um de cada vez em sequência pois sobrescreveriam os dados destes campos após a execução das rotinas.
# Para evitar esta sobrescrita e desconfiguração dos modelos de tabelas de quantitativos, usa-se este artificio de parâmetros extras.
# Como vários projetos poderão se valer destes modelos de tabelas de quantitativos e das rotinas Dynamo desenvolvidas, é mais fãcil criar os parâmetros adicionais como externos e de maneira compartilhada definindo-os em uma planilha do Excel e executando a sua criação de maneira automatizada através desta rotina.
# Novos parâmetros podem ser adicionados na planilha, de acordo com a necessidade do projeto.
# Para tidos de dados distintos, como texto, numero, volume, url, etc crie planilhas diferentes e, ao importar defina os seus tipos correspondentes, um de cada vez e em plailhas distintas com os seu respectivos nomes de parâmetro. Evite criar nomes iguais de planilhas em mais de um arquivo do excel. Acrescente um prefixo especifico em cada um deles, de acordo com o seu tipo, antes de seu nome, para evitar confusões ao usá-los nos projetos.
# note: É Necessário criar um arquivo de parâmetros compartilhados no Revit antes da criação dos mesmos :
# •  Abra o Revit e um projeto qualquer
# •  Selecione o menu Gerenciar => Parâmetros compartilhados
# •  Clique no botâo "Criar" da tela  "Editar parâmetros copmpartilhados" e escolha um local de acesso comum ou compartilhado para que o mesmo possa ser acessivel de qualquer lugar pelo projeto
# •   Defina o nome do arquivo compartilhado
#     (Ex: Parametros.txt)
# É necessário criar uma planilha do Excel com as colunas especificas do modelo :
# •  SharedParameters.xlsx
# Criar, lina a linha, as informações dos parâmetros compartilhados desejados.
# Executar a rotina

# group: Importa dados do Excel
# note: Localize a planilha do Excel contendo os parâmetros compartilhados a serem criados
n1_arquivo_de_parâmetros_do_excel = Filename(".\SharedParams.xlsx")  # "1 - Arquivo de parâmetros do Excel"; graph input
# note: Nome da folha/sheet da planilha
code_block = CodeBlock { "Standard"; false; }
openXMLImportExcel = Data.OpenXMLImportExcel(filePath=n1_arquivo_de_parâmetros_do_excel, sheetName=code_block.out0, readAsString=code_block.out1)

# group: Obtém valores da lista
# Obtém dados específicos de cada coluna da lista descartando o primeiro (cabeçalho)
# note: Processa e extrai os dados recebidos do Excel
code_block_2 = CodeBlock(data=openXMLImportExcel)
# ---------- code_block_2.designscript (31 lines) ----------
//Process excel data

// Descarta primeiro item da lista (Cabeçalhos)
dropped = DSCore.List.DropItems(data, 1);

// Transpõe lista - Troca linha por coluna
data_t  = DSCore.List.Transpose(dropped);

//Values for SP node

//Obtém valores das colunas
// Correspondente aos valores
// de cada índice da lista

// Parameter Name
sp_nmes   = data_t[0];

// Group name
sp_grps   = data_t[1];

//Spec Type
p_types   = data_t[2];

// Parameter Group
p_BIpgs   = data_t[4];

// Instance Parameter ?
p_inst    = data_t[5] == "Yes";

// Report Parameter ?
p_rept    = data_t[6] == "Yes";
# ----------------------------------------

# group: Observadores dos valores obtidos
# Estebloco serve apenas para vaisualização dos dos valores obbtidos da da planilha do Excel
parameter_name = Watch(code_block_2.sp_nmes)
group_name = Watch(code_block_2.sp_grps)
spec_type = Watch(code_block_2.p_types)  # frozen
parameter_group = Watch(code_block_2.p_BIpgs)  # frozen
instance_parameter = Watch(code_block_2.p_inst)  # frozen
report_parameter = Watch(code_block_2.p_rept)  # frozen
dados_recebidos_sem_o_cabeçalho = Watch(code_block_2.dropped)  # frozen

# group: Cria os parâmetros compartilhados
# note: Defina se será criado um grupo único para todos os parâmetros ou específicos para cada parâmetro  informado na planilha do Excel de entrada
n2_nome_de_grupo_comum = BoolSelector(true)  # "2 - Nome de Grupo Comum ?"; graph input
# note: Defina o nome do grupo comum dos parâmetros
n3_nome_do_grupo_comum = StringInput("Aux2")  # "3 - Nome do grupo comum"; graph input
# note: Decide se usa GroupName Definido pelo usuário na rotina do Dynamo ou se usa o nome específico obtido de cada parâmetro da planilha do Excel
code_block_3 = CodeBlock(OrigemExcel=n2_nome_de_grupo_comum, dados_excel=code_block_2.sp_grps, groupName=n3_nome_do_grupo_comum)
# ---------- code_block_3.designscript (11 lines) ----------
// GroupName
// Usar nome especifico
//  para cada parametrro
//  do excel ?
OrigemExcel == true ?

// Encaminha dados do Excel
dados_excel :

// Encaminha nome de grup único
groupName;
# ----------------------------------------
# note: Defina o SpecType do grupo de parâmetros
n4_spectype = SpecTypes("autodesk.spec:spec.string")  # "4 - SpecType"; graph input
# note: Defina o GroupType dos parâmetros
n5_grouptype = GroupTypes("autodesk.parameter.group:identityData")  # "5 - GroupType"; graph input
# note: Cria os parâmetros compartilhados para todas as categorias
createSharedParameterForAllCategories = Parameter.CreateSharedParameterForAllCategories(parameterName=code_block_2.sp_nmes, groupName=code_block_3, specType=n4_spectype, groupType=n5_grouptype, instance=code_block_2.p_inst)
