# Dynamo graph Clash_detective_MEP-Vinculo-Estrut.dyn (Dynamo 2.17.0.3472)
# Cria vistas e um relatório de Detecção de Conflito dos elementos selecionados X o vínculo selecionado

# group: Class Detective
# note: Detector de Conflitos/Interferências/Colisões entre elementos de disciplinas diferentes.
# •  Cria vistas e um relatório de detecção de conflito dos elementos selecionados X o vínculo selecionado
# •  Gera vistas 3D de elementos do projeto aberto que estiverem em conflito com elementos de categorias especificados de um arquivo vinculado.
# •  Gera uma legenda (lista) com estes mesmos elementos conflitantes para conferência.
# •  As colisões obtidas podem ser destacadas em cada vista 3D gerada com uma cor e efeito de transparência para facilitar a sua localização.
# OBS:
# •  É necessário existir pelo menos uma legenda no arquivo para que a rotina funcione. Se nâo existir, crie uma em branco
# •  Também é necessário informar um nome de fonte de caracteres que exista no projeto para que a legenda possa ser gerada. Verifique o nome de alguma e o informe respeitando maiúsculas, espaçamento, etc.
# •  O Script pode ser evoluído para exportar a lista de colisões obtidas para uma planilha do Excel.

# group: Input
# Define se deve aplicar core de destaque nos elementos da vista ativa
n03_aplicar_cores_nos_elementos = BoolSelector(false)  # "03 - Aplicar cores nos elementos na vista ativa?"; graph input

# group: Inputs
# Entradas principais necessárias para exexcução da rotina
# note: Selecione os elementos do projeto aberto que se deseja verificar colisão arrastando o mouse sobre a região desejada da vista 3D, por exemplo
n01_selecione_os_elementos = DSModelElementsSelection()  # "01 - Selecione os elementos"; 126 picked in the model; graph input
# note: Selecione a planta do arquivo arquitetônico ou estrutural vinculado na vista, normalmente delimitado por um retangulo azul
n02_selecione_os_vínculos = DSModelElementSelection()  # "02 - Selecione os Vínculos"; 1 picked in the model; graph input
# note: Informe a tolerância dadetecção desejada
n03_tolerância_cm = DoubleInput(1)  # "03 - Tolerância (cm)"; graph input

# group: Categorias para encontrar o conflito
# Categorias do arquivo de projeto arquitetônico ou estrutural vinculado a serem confrontadas com os elementos selecionados do projeto aberto. Ajuste as categorias desejadas acrescentando ou removendo-as ao nó de criação de lista
categories = Categories("OST_Floors")
categories_2 = Categories("OST_StructuralColumns")
categories_3 = Categories("OST_Rebar")
# note: Monta um alista com as categorias desejadas
list_create = List.Create(item0=categories, item1=categories_2, item2=categories_3)
# note: Converte os objetos em String
string_from_object = FromObject(object=list_create)

# group: Obter os elementos conflitantes
clash_detective = Python(IN[0]=n01_selecione_os_elementos, IN[1]=n02_selecione_os_vínculos, IN[2]=n03_tolerância_cm, IN[3]=string_from_object)  # CPython3
# ---------- clash_detective.python (50 lines) ----------
import clr
clr.AddReference('RevitAPI')
from Autodesk.Revit.DB import *
clr.AddReference("RevitServices")
from RevitServices.Persistence import DocumentManager

# Documentos e Interfaces
doc = DocumentManager.Instance.CurrentDBDocument

#---CLASSES E FUNÇÕES

#---SCRIPT

# Entradas do script
observed_elements = UnwrapElement(IN[0])  # Lista de elementos a serem observados
link_instance = UnwrapElement(IN[1])  # Instância do vínculo como entrada do nó
tolerancia = UnitUtils.ConvertToInternalUnits(IN[2],UnitTypeId.Centimeters) #Tolerância em cm para ser utilizada
category_names = IN[3]  # Lista de nomes de categorias permitidas

# Obter o documento vinculado a partir da instância do vínculo
linked_doc = link_instance.GetLinkDocument()

# BoundingBoxes dos elementos observados
boundingBoxes = [element.get_BoundingBox(doc.ActiveView) for element in observed_elements]

# Obter as Outlines
outlines = [Outline(bb.Min, bb.Max) for bb in boundingBoxes]

# Filtros BoundingBoxIntersectsFilter
filters = [BoundingBoxIntersectsFilter(outline, tolerancia,False) for outline in outlines]

# Obter todos os elementos dentro das BoundingBoxes do modelo vinculado
elements = [FilteredElementCollector(linked_doc).WherePasses(filter).WhereElementIsNotElementType().ToElements() for filter in filters] 

# Lista de elementos observados e lista de elementos relacionados
observed_elements_list = []
related_elements_list = []

# Verificar se a categoria dos elementos capturados está na lista de categorias permitidas
for i, related_elements in enumerate(elements):
    filtered_related_elements = []
    for element in related_elements:
        if element.Category and element.Category.Name in category_names:
            filtered_related_elements.append(element)
    
    if filtered_related_elements: 
        related_elements_list.append(filtered_related_elements)
        observed_elements_list.append(observed_elements[i])

OUT = observed_elements_list, related_elements_list
# ----------------------------------------
firstItem = List.FirstItem(list=clash_detective)
lastItem = List.LastItem(list=clash_detective)

# group: Aplicar cores nos elementos da vista ativa
code_block = CodeBlock { 255; }
byARGB = Color.ByARGB(blue=code_block)
overrideColorInView = Element.OverrideColorInView(color=byARGB)  # unwired: element
function_compose = ComposeFunctions()  # unwired: function0, function1
if_ = RefactoredIf(test=n03_aplicar_cores_nos_elementos, true=overrideColorInView, false=function_compose)
function_apply = ApplyFunction(function=if_, argument0=firstItem)

# group: Criar o único nome das vistas
getCategory = Element.GetCategory(element=firstItem)
string_from_object_2 = FromObject(object=getCategory)
sortByKey = List.SortByKey(list=firstItem, keys=string_from_object_2)
getCategory_2 = Element.GetCategory(element=sortByKey.sortedList)
id = Element.Id(element=sortByKey.sortedList)
code_block_2 = CodeBlock(cat=getCategory_2, id=id) { cat + " - ID " + id; }
createUniqueViewName = View3D.CreateUniqueViewName(name=code_block_2)
elementos_com_conflito = Watch(sortByKey.sortedList)  # graph output

# group: Input - Transparência
# Define o percentual da transparência nas vistas 3D
n04_transparência = IntegerSlider(50, range=0..100 step 1)  # "04 - Transparência"; graph input

criar_vistas_com_filtros = Python(IN[0]=createUniqueViewName, IN[1]=sortByKey.sortedList, IN[2]=n02_selecione_os_vínculos, IN[3]=n04_transparência)  # CPython3
# ---------- criar_vistas_com_filtros.python (130 lines) ----------
#Python Script by Fellipe Caetano - BIM Coder
#Aprenda Dynamo e Revit API do zero! https://bimcoder.net/

#---IMPORTAÇÕES
# Sistema e .NET
import clr
import sys
import System
from System import Array
from System.Collections.Generic import *

# Biblioteca de Geometria do Dynamo
clr.AddReference('ProtoGeometry')
from Autodesk.DesignScript.Geometry import *

# Nós do Dynamo
clr.AddReference('RevitNodes')
import Revit
clr.ImportExtensions(Revit.Elements)
clr.ImportExtensions(Revit.GeometryConversion)

# Documentos e Transações
clr.AddReference('RevitServices')
import RevitServices
from RevitServices.Persistence import DocumentManager
from RevitServices.Transactions import TransactionManager

# DB da API do Revit
import Autodesk
clr.AddReference('RevitAPI')
from Autodesk.Revit.DB import *

# Interface do usuário da API do Revit
clr.AddReference('RevitAPIUI')
from Autodesk.Revit.UI import *

# Documentos e Interfaces
doc = DocumentManager.Instance.CurrentDBDocument
uiapp = DocumentManager.Instance.CurrentUIApplication
app = uiapp.Application
uidoc = uiapp.ActiveUIDocument

#---CLASSES E FUNÇÕES

#---SCRIPT

# Função para criar uma vista 3D
def create_3d_view(view_names):
    created_views = []
    # Filtra o tipo de vista 3D disponível no documento
    view_family_type = FilteredElementCollector(doc).OfClass(ViewFamilyType).ToElements()
    view_3d_type = None
    for vft in view_family_type:
        if vft.ViewFamily == ViewFamily.ThreeDimensional:
            view_3d_type = vft
            break

    if view_3d_type:

        # Verifica se a entrada é uma lista de nomes ou um único nome
        if isinstance(view_names, list):
            for view_name in view_names:
                view_3d = View3D.CreateIsometric(doc, view_3d_type.Id)
                view_3d.Name = view_name
                created_views.append(view_3d)
        else:
            view_3d = View3D.CreateIsometric(doc, view_3d_type.Id)
            view_3d.Name = view_names
            created_views.append(view_3d)

    return created_views

# Função para isolar os elementos e aplicar cores
def IsolateElements(view,element_isolate,linkInstance):
    all_elements_ids = FilteredElementCollector(doc).WhereElementIsNotElementType().ToElementIds()
    
    for id in all_elements_ids:
        try:
            view.HideElements(List[ElementId]([id]))
            test.append(doc.GetElement(id))
        except:
            pass
            
    view.UnhideElements(List[ElementId]([element_isolate.Id]))
    
    view.IsSectionBoxActive = True
    view.DetailLevel = ViewDetailLevel.Fine
    view.DisplayStyle = DisplayStyle.FlatColors
    
    # Override de cor para o elemento de referência (azul)
    override_graphics = OverrideGraphicSettings()
    override_graphics.SetProjectionLineColor(Color(0, 0, 255))  # Azul
    override_graphics.SetSurfaceForegroundPatternColor(Color(0, 0, 255))
    override_graphics.SetSurfaceTransparency(IN[3])
    view.SetElementOverrides(element_isolate.Id, override_graphics)
    
 
    view.UnhideElements(List[ElementId]([linkInstance.Id]))
                           
    return view

# Entrada dos dados
view_names = IN[0]  # Nome ou lista de nomes para as vistas

# Lista com elementos à serem isolados para cada vista
elements_isolate = UnwrapElement(IN[1])

# Vínculo relacionado
linkInstance = UnwrapElement(IN[2])

newViews=[]


TransactionManager.Instance.EnsureInTransaction(doc)

# Cria as vistas 3D e retorna a lista de vistas criadas
created_views = create_3d_view(view_names)


for view,element_isolate in zip(created_views,elements_isolate):
    
    newView = IsolateElements(view,element_isolate,linkInstance)
    newViews.append(newView)
    
TransactionManager.Instance.ForceCloseTransaction()

OUT = newViews


 
# ----------------------------------------
vistas_criadas = Watch(criar_vistas_com_filtros)  # graph output

# group (continued): Obter os elementos conflitantes
sortByKey_2 = List.SortByKey(list=lastItem, keys=string_from_object_2)

# group: Input - Fonte e espaçamento das linhas da legenda
# Define o fonte e espaçamento das linhas da legenda a ser gerada
fonte = StringInput("Schedule Default")
byName = TextNoteType.ByName(name=fonte)
espaçamento_cm = DoubleInput(50)
fonte_2 = StringInput("2.0mm Arial")  # frozen
fonte_3 = StringInput("2.0 Tw Cen MT Bold")
fonte_4 = StringInput("2.50 Tw Cen MT")

# group: Criar legenda de relatório
code_block_3 = CodeBlock(ref=sortByKey.sortedList, conf=sortByKey_2.sortedList)
# ---------- code_block_3.designscript (7 lines) ----------
ref_name = ref.Name;
ref_Id = ref.Id;

conflict_name = conf.Name;
conflict_id = conf.Id;

total = "ID: " +ref_Id  +" - "+ ref_name + " | ID: " +conflict_id+" - " + conflict_name;
# ----------------------------------------
criar_legenda_de_relatório = Python(IN[0]=code_block_3.total, IN[1]=byName, IN[2]=espaçamento_cm)  # CPython3
# ---------- criar_legenda_de_relatório.python (109 lines) ----------
#Python Script by Fellipe Caetano - BIM Coder
#Aprenda Dynamo e Revit API do zero! https://bimcoder.net/

# Importando as bibliotecas necessárias
import clr
clr.AddReference('RevitServices')
clr.AddReference('RevitAPI')
clr.AddReference('RevitNodes') 

from RevitServices.Persistence import DocumentManager
from RevitServices.Transactions import TransactionManager
from Autodesk.Revit.DB import * 
from Autodesk.Revit.UI import TaskDialog


#---CLASSES E FUNÇÕES

# Obtendo o documento ativo do Revit
doc = DocumentManager.Instance.CurrentDBDocument

# Função para duplicar a legenda
def duplicate_legend():
    # Filtra as vistas de legenda no documento
    views = FilteredElementCollector(doc).OfClass(View).ToElements()
    
    # Procura a legenda pelo nome
    for view in views:
        if view.ViewType == ViewType.Legend:
            # Duplica a legenda
            new_legend_id = view.Duplicate(ViewDuplicateOption.Duplicate)
            new_legend = doc.GetElement(new_legend_id)
            try:
                new_legend.Name = "RELATÓRIO CLASHES DYNAMO - BY BIM CODER"
            except:
                collector = FilteredElementCollector(doc).OfClass(View)
                for v in collector:
                    if v.Name == "RELATÓRIO CLASHES DYNAMO - BY BIM CODER":
                        doc.Delete(v.Id)
                        break
                        
                new_legend.Name = "RELATÓRIO CLASHES DYNAMO - BY BIM CODER"
            
            new_legend.Scale = 50            
            
            return new_legend
             
    
            
# Função para inserir textos com separador entre listas
def insert_texts(legend, list_of_text_lists, start_point, line_spacing,text_note_type):
    
    # Define as coordenadas iniciais
    current_y = start_point.Y
    
    #Tamanho de linha máximo 
    max_width=0
    
    # Para cada lista de textos
    for text_list in list_of_text_lists:
        # Para cada texto na lista
        for text in text_list:
            # Define o ponto de inserção do texto
            text_point = XYZ(start_point.X, current_y, start_point.Z)
            
            # Cria uma nova anotação de texto
            new_text_note = TextNote.Create(doc, legend.Id, text_point, text, text_note_type.Id)
            
            # Calcula o próximo Y com base na altura do texto atual
            current_y -= new_text_note.Height+ line_spacing
            
            #Verifica o tamanho da linha maximo
            if len(text) > max_width: max_width = len(text)
        
        # Após o último texto da lista, adiciona uma linha de separação
        text_point = XYZ(start_point.X, current_y, start_point.Z)
        TextNote.Create(doc, legend.Id, text_point, "-"*(max_width+20), text_note_type.Id)
        
        # Adiciona espaçamento após a linha de separação
        current_y -= line_spacing 
  

# Listas de textos a serem inseridos (entradas múltiplas)
list_of_text_lists = IN[0] 

#Tipo do texto
text_note_type = UnwrapElement(IN[1])

# Ponto inicial para o primeiro texto (coordenadas XYZ)
start_point = XYZ(0, 0, 0)

# Espaçamento entre as linhas
line_spacing = UnitUtils.ConvertToInternalUnits(IN[2],UnitTypeId.Centimeters)  # Ajuste conforme necessário 
 
# Inicia a transação
TransactionManager.Instance.EnsureInTransaction(doc) 

# Cria a legenda
legend = duplicate_legend()
if legend:
    # Executa a função para inserir as listas de textos
    insert_texts(legend, list_of_text_lists, start_point, line_spacing,text_note_type)
    
    # Finaliza a transação 
    TransactionManager.Instance.TransactionTaskDone()
    
    # Saída 
    OUT = legend
else:
    dialog = TaskDialog.Show("Aviso","Crie pelo menos uma legenda no modelo.") 
# ----------------------------------------
