# Dynamo graph Cotas_automaticas.dyn (Dynamo 2.17.0.3472)
# Insere cotas entre dispositivos elétricos orientados em uma mesma direção
# packages: Genius Loci 2024.5.29, Crumple 2021.5.27

# note: Nova nota

# group: Criação de cotas automáticas entre dispositivos
# note: Rotina auxiliar de criação de cotas em dispositivos elétricos
# Esta rotina tem a intenção de agilizar o lançamento de cotas entre dispositivos elétricos do mesmo tipo evitando-se a necessidade da procura do ponto de alinhamento de cada um em relação a outro e também evita o deslocamento acidental dos mesmos de sua posição original, normalmente ao se clicar com o mouse sobre os mesmos.
# •  Executar a rotina pelo ícone da imagem para abrir a tela de configuração dos parâmertos de lançamento
# •  Não clique no triângulo da tela que possui a lista minimizada de rotinas Dynamo disponíveis porque é necessário várias configurações para o seu correto funcionamento e também para permitir o seu uso em sequência na seleção de vários blocos de dispositivos com seus devidos alinhamentos e pontos de inserção das linhas das cotas na posição mais adequada da vista aberta.
# Antes de clicar no botão "Executar" na parte inferior da tela :
# •  Selecionar na vista aberta, com o "clique" e "arrastar" do botão esquerdo do mouse, os dispositivos elétricos do mesmo tipo alinhados em uma mesma direção (em linha ou coluna) e orientação (virados para um mesmo lado).
# •  Escolher se a cota a ser inserida será disposta em uma linha horizontal ou vertical.
# •  A orientação da inserção da cota deve seguir a mesma orientação dos dispositivos selecionados, ou seja, se foram selecionados os dispostos na horizontal, escolher posicionamento da cota em linha horizontal. Se forem selecionados dispostos em uma  linha vertical, escolher posicionamento da cota em linha verical.
# Estilo da cota :
# •  Se escolhido o modelo de estilo padrão, a cota a ser inserida usará o último estilo usado no aplicativo (segue o último modelo adotado pelo usuário).
# •  Se optado por um estilo fixo, deve  ser verificado primeiro o seu nome exato, preservando maiúsculas ,minúsculas, espaçamento, caracteres, etc e informar o seu nome no campo do estilo da tela de configuração.
# A execução da inserção da cota na planta só deve ser feita depois de seguidos estes passos acima.
# Manter a tela aberta para selecionar novos agrupamentos de dispositivos em outras orientações, alterando apenas os parâmetros de seu interesse e clicando novamente no botão de Executar da parte inferior da tela para que a linha da cota da seleção de disposisitos seja criada e um novo ciclo de seleção possa ser iniciado.
# note: Esta rotina possui um nó "Select Point" correspondendo a um script personalizado em Python criado com a versão Iron Python 2.7
# Se a versão do Python instalada for superior, poderá não funcionar.
# Neste caso, clique com o mouse sobre o nó acima e selecione "Editar" no menu suspenso para abrir a janela do editor de códigos Python.
# Na janela do editor de códigos que se abrirá, selecione na parte inferior a opção do IronPython 2 ao invés da opção Python 3 (ou semelhante).
# Pode ser que seja necessário carregar o pacote do Iron Python 2.7 se o mesmo não estiver instalado em sua máquina.
# note: Esta rotina utiliza um nó "OldIf" do pacote "Crumple" ao invés do nó "If" dos n´s padrões do Revit.
# O pacote "Crumple" possi alguns nós que podem estar sendo utilizados em outros scripts e para manter compatibilidade com o nó "If" original do Dynamo, este pacote disponibilizou esta rotina alternativa.
# Se o nó "If" for utilizado e tiver algum comportamento anormal em algum outro script, utilize este nó "OldIf" em seu lugar e avalie os resultados.
# Por precaução, este script atual está usando o nó de compatibilidade "OldIf" porque notou-se uma maior lentidão de execução ao usar o pacote "If".
# Os dois nós estão funcionando. Porém, foi optado deixar a verão de compatibilidade disponibilizada no pacote do Crumple apenas por segurança.

# group: Desenha linha da cota
# note: Instalar e selecionar o pacote do Iron Python 2.7
# •  Edite o node
# •  Selecione Executar : IronPython 2.7
select_point = Python()  # CPython3; unwired: IN[0]
# ---------- select_point.python (34 lines) ----------
import clr
import sys
import System
from System.Collections.Generic import *

clr.AddReference('ProtoGeometry')
from Autodesk.DesignScript.Geometry import *

clr.AddReference('RevitNodes')
import Revit
clr.ImportExtensions(Revit.Elements)
clr.ImportExtensions(Revit.GeometryConversion) 

clr.AddReference("RevitServices")
import RevitServices
from RevitServices.Persistence import DocumentManager
from RevitServices.Transactions import TransactionManager

clr.AddReference('RevitAPI')
clr.AddReference('RevitAPIUI')
import Autodesk
from Autodesk.Revit.DB import *
from Autodesk.Revit.UI import *
from Autodesk.Revit.UI import Selection

doc = DocumentManager.Instance.CurrentDBDocument
uiapp = DocumentManager.Instance.CurrentUIApplication
app = uiapp.Application
uidoc = uiapp.ActiveUIDocument

point = uidoc.Selection.PickPoint("")
point_dyn = point.ToPoint()

OUT = point_dyn
# ----------------------------------------
# note: Posicionamento da cotas (Horizontal ou vertical )
n2_é_cota_horizontal = BoolSelector(true)  # "2. É cota horizontal ?"; graph input
XAxis = Vector.XAxis()
YAxis = Vector.YAxis()
# note: OldIff parece executar mais rápido que o If normal
oldif = Custom[© OldIf](If=n2_é_cota_horizontal, Then=XAxis, Else=YAxis)  # package Crumple; Retains the functionality of the old if node (no Python used). All credit to the Zebra package - hadn't been updated since 2016 so decided to give it a new home.
byStartPointDirectionLength = Line.ByStartPointDirectionLength(startPoint=select_point, direction=oldif)

# group: Seleciona os dispositivos elétricos a serem cotados entre sí
# A rotina não cria cotas entre dispositivos de orientações diferentes. A orientação da linha de inserção da cota tem que ser a mesma da linha de seleção dos dispositvos selecionados
# note: Selecione os dispositivos elétricos a serem cotados
# •  Não misture cotas horizontais com verticais na seleção
# •  Escolha dispositivos sempre com a mesma orientação em relação a da inserção da linha da cota na vista
n1_selecione_os_elementos_a_cotar = DSModelElementsSelection()  # "1. Selecione os elementos a cotar"; 2 picked in the model; graph input
# note: Especifica a orientação da família dos dispositivos
# •  As cotas só tratam famílias com uma mesma orientação definida nos seus respectivos modelos
string = StringInput("Center (Left/Right)")
familyinstance_reference_byname = Custom[FamilyInstance Reference ByName](familyInstance=n1_selecione_os_elementos_a_cotar, name=string)  # package Genius Loci; Works only in Revit 2018.1 and later. Gets the reference corresponding to the named reference plane in the instance's family.

# group: Escolhe um estilo de cota a ser usado
# A rotina escolhe o ultimo modelo selecionado no projeto, se optado pelo estilo padão. Para estilos personalizados ou fixos, deve-se inserir o nome exato do estilo desejado no campo de especificação do mesmo. O estilo especificado precisa existir como uma família no projeto para funcionar adequadamente
# note: Utilizar o estilo padrão ou um estilo específico ?
# •  O sistema selecina o último modelo de cota usado se optado pelo uso do modelo padrão
n3_estilo_padrão_de_cota = BoolSelector(true)  # "3. Estilo padrão de cota ?"; graph input
code_block = CodeBlock { null; }
element_classes = ElementTypes("DimensionType")
all_elements_of_class = ElementsOfType(element_class=element_classes)
name = Element.Name(element=all_elements_of_class)
# note: Informe o nome exato do estilo de cota a ser usado se optar por um modelo diferente do padrão
# •  O modelo especificado precisa existir no projeto
n4_estilo_da_cota = StringInput("Arrow - 2.0 Tw Cen MT Transparente Red")  # "4. Estilo da cota"; graph input
eq = name == n4_estilo_da_cota
filterByBoolMask = List.FilterByBoolMask(list=all_elements_of_class, mask=eq)
if_ = RefactoredIf(test=n3_estilo_padrão_de_cota, true=code_block, false=filterByBoolMask.in)
watch = Watch(if_)

# group: Cria as cotas
# note: Cria as cotas na vista no ponto de inserção clicado com o mouse após seleção dos dispositivos
dimension_byreferences = Custom[Dimension ByReferences](line=byStartPointDirectionLength, references=familyinstance_reference_byname.Reference, dimensionType=if_)  # package Genius Loci; Creates a new linear dimension from at least two geometric references of an object.
