# Dynamo graph Criar_tabelas_base.dyn (Dynamo 2.17.0.3472)
# author: Fellipe Caetano
# Gera tabela básica para  levantamento de parâmetros
# packages: archi-lab.net 2024.217.1024

# group: Cria tabela vazia para a categoria
# note: Define a categoria a ser listada na tabela
n01_categoria = Categories("OST_TelephoneDevices")  # "01 - Categoria"; graph input
# note: Define o nome da nova tabela
n02_nome = StringInput("Dispositivos de  telefonia")  # "02 - Nome"; graph input
# note: Define o tipo da nova tabela
schedule_type = ScheduleTypes("RegularSchedule")
# note: Cria uma nova tabela vazia no projeto
createSchedule = ScheduleView.CreateSchedule(category=n01_categoria, name=n02_nome, scheduleType=schedule_type)

# group: Adiciona os campos na tabela
# note: Obtém a lista de campos já disponíveis inicalmente para serem selecionados e usados na tabela
schedulableFields = ScheduleView.SchedulableFields(scheduleView=createSchedule)
# note: Defina os nomes dos parâmetros/colunas tabeláveis disponíveis no template desejados  separados por ";"
n03_parâmetros = StringInput("Comentários;Tipo;Contagem")  # "03 - Parâmetros"; graph input
# note: Define o separador dos campos da string
string = StringInput(";")
# note: Quebra a string de entrada em campos/colunas aos quais foram informados e separados pelo separador ";" para gerar uma lista dos mesmos
split = String.Split(string=n03_parâmetros, separator0=string)
# note: Transforma os Fields de Objeto para String
string_from_object = FromObject(object=schedulableFields)
# note: Necessário usar opção Treliça (CrosTab Reference) para gerar todas as combinações como produto cartesiano para obter os itens desejados na lista extensa de parâmetros disponíveis de campos tabeláveis
eq = split == string_from_object  # lacing=CrossProduct
# note: Filtra a lista de campos desejados, usando nível L2 na máscara da lista para obter os itens desejados
filterByBoolMask = List.FilterByBoolMask(list=schedulableFields, mask=eq@L2)
# note: Elimina um nível da lista
# (Achata a lista)
flatten = List.Flatten(list=filterByBoolMask.in)
# note: Adiciona os fields obtidos da lista filtrada na tabela criada
addFields = ScheduleView.AddFields(scheduleView=createSchedule, fields=flatten)
# note: Seleciona um View Template (Modelo de vista) a ser aplicado na criação da tabela (Opcional)
n04_view_template = ViewTemplatesUi("Dados")  # "04 - View Template"; graph input
# note: Aplica o View Template (Modelo de vista) na tabela
setViewTemplate = archilab.Revit.Views.Views.SetViewTemplate(view=addFields, viewTemplate=n04_view_template)

# group: Define ordenação da tabela
# note: Define o parâmetro de classificação da tabela
n05_parâmetro_de_classificação = StringInput("Tipo")  # "05 - Parâmetro de classificação"; graph input
# note: Define opções de geração da tabela
# Estas opções podem ser deixadas todas disponiveis  ao usuário. Basta criar várias entradas Boolean e troná-las selecionáveis na tela da rotina para torná-la mais flexivel
boolean = BoolSelector(false)
# note: Define ordenação dos itens da tabela
n06_ordenação = ScheduleSortOrderUi("Ascending")  # "06 - Ordenação"; graph input
# note: Node de ordenação e agrupamento de dados para ser aplicado na tabela
schedule_sorting_grouping = Custom[Schedule Sorting Grouping](schedule=setViewTemplate, parameterName=n05_parâmetro_de_classificação, blankLine=boolean, footerCount=boolean, footerTitle=boolean, header=boolean, sortOrder=n06_ordenação)  # package archi-lab.net; This node will allow you to specify sorting/grouping parameters in schedule as well parameters like sorting order, whether its a footer or header. Visit archi-lab.net for more information.

# group: Define agrupamento dos itens
boolean_2 = BoolSelector(false)
# note: Define se a tabela será itenizada
# (lista os itens sem agrupar, ou seja, uma linha para cada ocorrência, mesmo que haja repetição do mesmo)
isItemized = archilab.Revit.Views.ScheduleViews.IsItemized(view=setViewTemplate, isItemized=boolean_2)

# group: Define filtro de dados
fields = ScheduleView.Fields(scheduleView=isItemized)
# note: Especifica a string da comparação/filtrgem
string_2 = StringInput("Tipo")
# note: Transforma objeto em String
string_from_object_2 = FromObject(object=fields)
# note: Compara
# (usando Crosstab Referenca)
eq_2 = string_2 == string_from_object_2  # lacing=CrossProduct
filterByBoolMask_2 = List.FilterByBoolMask(list=fields, mask=eq_2@L2)
# note: Define uma condição de filtragem especifica
# (nâo contém)
# Personalizar esta condição de filtragem
schedule_filter_type = ScheduleFilterType("NotContains")
# note: Espefifica a string da condição de filtragem
string_3 = StringInput("Luva")
# note: Prepara condição da filtragem
byFieldTypeAndValue = Revit.Schedules.ScheduleFilter.ByFieldTypeAndValue(field=filterByBoolMask_2.in, filterType=schedule_filter_type, value=string_3)
# note: Especifica os parâmetros de filtragem dos dados
addFilters = ScheduleView.AddFilters(scheduleView=isItemized, scheduleFilters=byFieldTypeAndValue)

# group: Define fontes dos elementos da tabela
string_4 = StringInput("2.50 Tw Cen MT")
# note: Define um tipo de fonte
# •  Tem que existir no template
byName = TextNoteType.ByName(name=string_4)
string_5 = StringInput("2.00 Tw Cen MT Bold")
byName_2 = TextNoteType.ByName(name=string_5)
string_6 = StringInput("2.75 Tw Cen MT")
byName_3 = TextNoteType.ByName(name=string_6)
# note: Configura aparência da tabela
schedule_appearance = Custom[Schedule Appearance](schedule=addFilters, titleTextTypeId=byName, headerTextTypeId=byName_2, bodyTextTypeId=byName_3)  # package archi-lab.net; This node allows you to control the appearance of the schedule. For now it supports only title, header and body text type.
string_7 = StringInput("Schedule Default")
# note: Outros exemplos de fonte
byName_4 = TextNoteType.ByName(name=string_7)
