# Dynamo graph Delete_backups_rvt_rfa.dyn (Dynamo 2.17.0.3472)
# author: Marcos Antonio Cascelli
# Apaga arquivos de backup rvt e rfa recursivamente a partir do diretório informado

# group: Apaga backups do Revit
# note: Utilize esata rotina como uma ferramente prática de manutrenção para apagar os arquivos de backup criados automaticamente pelo Revit durante o uso do aplicativo.
# Esta rotina serve para limpar e liberar espaço de armazenamento do disco durante o desenvolvimento de projetos.
# Mantenha backups regulares de seus projetos em locais extras, tais como HDDs externos ou storages de rede como boa prática de segurança

# group: Apaga arquivos de backup do Revit
# Apaga arquivos de backup criados pelo Revit das extensões rvt e rfa salvos automaticamente por ele durante o uso de maneira reursiva
# note: Abre navegador para localizar pasta base
n1_pasta_base_para_apagar_backups = Directory("Nenhum arquivo selecionado.")  # "1. Pasta base para apagar backups RVT e RFA"; graph input
# note: Requer confirmação antes da execução da rotina
n2_confirma_exclusão_dos_backups = BoolSelector(true)  # "2. Confirma exclusão dos backups ?"; graph input
# note: Executa exclusão de arquivos de backup a partir da pasta base de maneira recursiva, ou seja, entrando nos subdiretórios da mesma
python_script = Python(IN[0]=n1_pasta_base_para_apagar_backups, IN[1]=n2_confirma_exclusão_dos_backups)  # CPython3
# ---------- python_script.python (49 lines) ----------
import clr
import sys
import System
from System.Collections.Generic import *

clr.AddReference('ProtoGeometry')
from Autodesk.DesignScript.Geometry import *

clr.AddReference('RevitNodes')
import Revit
clr.ImportExtensions(Revit.Elements)
clr.ImportExtensions(Revit.GeometryConversion)

clr.AddReference("RevitServices")
import RevitServices
from RevitServices.Persistence import DocumentManager
from RevitServices.Transactions import TransactionManager

clr.AddReference('RevitAPI')
clr.AddReference('RevitAPIUI')
import Autodesk
from Autodesk.Revit.DB import *
from Autodesk.Revit.UI import *
import os
import re

doc = DocumentManager.Instance.CurrentDBDocument
uiapp = DocumentManager.Instance.CurrentUIApplication
app = uiapp.Application
uidoc = uiapp.ActiveUIDocument

root = IN[0]
deleteFiles = IN[1]

pattern1 = r"\.\d{4}\.rvt$"
pattern2 = r"\.\d{4}\.rfa$"

paths = []

for path, subdirs, files in os.walk(root):
	for fileName in files:
		if re.search(pattern1, fileName) or re.search(pattern2, fileName):
			filePath = os.path.join(path, fileName)
			paths.append(filePath)

			if deleteFiles:
				os.remove(filePath)			

OUT = paths
# ----------------------------------------
