# Dynamo graph Exporta_tabelas_para_excel.dyn (Dynamo 2.17.0.3472)
# Exporta tabelas de quantitativos para o Excel
# packages: Crumple 2021.5.27, bimorphNodes 3.0.3, Data-Shapes 2021.2.94

# group: Exporta tabelas para o Excel
# note: Exporta Tabelas de Quantitativos, Quadros, Ambientes, Espaços, etc existentes no projeto para planilha do Excel.
# • Cada tabela é criada em uma folha/sheet em separado na planilha de destino
# • A planilha de destino do Excel deve existir ou ser criada antes da exportação
# • As tabelas existentes serão listadas e podem ser selecionadas

# group: Obtém lista de tabelas exportáveis
# Seleciona as tabelas úteis exportáveis disponíveis no projeto com seus dados respectivos
# note: Custom Node: Crumple v.2021.5.27
# Obtém lista de tabelas
schedulesbytype = Custom[© SchedulesByType]()  # package Crumple; Returns all schedules in the model, separated into key and non-key schedules.
# note: Obtém o nome do elemento
name = Element.Name(element=schedulesbytype.schedules)
# note: Especifica s string " Internal" como parametro de filtragem para o node seguinte
code_block = CodeBlock { " Internal"; false; }
# note: Verifica se o nome da tabela possui a string passada como argumento (" Internal")
# Esta string será usada para descartar as tabelas identificadas como internas do projeto e deixar apenas as relevantes passíveis de processamento de seus dados
contains = String.Contains(string=name, searchFor=code_block.out0, ignoreCase=code_block.out1)
# note: Avalia a lista recebida contra a máscara booleana e a separa em duas, sendo uma com o resultado verdadeiro e outra com o resultado falso
# Cria uma lista de tabelas que não sejam internas do projeto deixando apenas as relevantes
# note: Nova nota
filterByBoolMask = List.FilterByBoolMask(list=schedulesbytype.schedules, mask=contains)

# group: Cria formulário de seleção de tabelas para exportação
# Monta o formulário com as tabelas do projeto para seleção pelo usuario e posterior geração
# note: Define parâmetros de configuração
code_block_2 = CodeBlock { "Exportar Tabelas"; "Exportar"; "Cancelar"; 900; 600; 200; }
# note: Define parametros de configuração
code_block_3 = CodeBlock { "Tabelas"; 400; true; false; }
# note: Obtém o nome da tabela
name_2 = Element.Name(element=filterByBoolMask.out)
# note: Cria uma lista das tabelas de entradas obtidas no projeto ordenadas pelo seu nome para seleção
listview_data = Custom[Listview Data](InputName=code_block_3.out0, Keys=name_2, Values=filterByBoolMask.out, Height_optionnal=code_block_3.out1, HilightInView_optionnal=code_block_3.out3, DisplayModeOnly_optionnal=code_block_3.out3, ShowElementCount_optionnal=code_block_3.out3, SortItems_optionnal=code_block_3.out2, ShowId_optionnal=code_block_3.out3)  # package Data-Shapes; Create data for ListView input in UI.MultiInputForm ++ . Check out www.data-shapes.net for more infos.
code_block_4 = CodeBlock { "Local"; "Selecione um arquivo Excel..."; }
# note: Custom Node: Data-Shapes v.2021.2.94
# Obtém o diretóio de localização do arquivo da planilha Excel que receberá os dados das tabelas
filepath_data = Custom[FilePath Data](InputName=code_block_4.out0, ButtonText=code_block_4.out1)  # package Data-Shapes; Create filepath input for UI.MultipleInputForm ++ . Check out www.data-shapes.net for more infos !
# note: Cria uma lista composta por duas informações distintas em cada elemento:
# •  Nome da tabela do projeto
# •  Path da planilha do excel de destino dos dados
list_create = List.Create(item0=listview_data, item1=filepath_data)
# note: Nova nota
boolean = BoolSelector(true)
# note: Custom Node: Data-Shapes v.2021.2.94
# Cria formulário com a lista das tabelas encontradas no projeto para permitir seleção múltipla  pelo usuário
multipleinputform = Custom[MultipleInputForm ++](Description_optional=code_block_2.out0, ButtonText_optional=code_block_2.out1, Inputs=list_create, Toggle=boolean, CancelButtonText_optional=code_block_2.out2, MaxHeight_optional=code_block_2.out3, Width_optional=code_block_2.out4, LabelWidth_optional=code_block_2.out5)  # package Data-Shapes; Create a form with multiple inputs. see www.data-shapes.net for tutorials and infos!

# group: Prepara tabelas selecionadas para exportação de seus dados
# Prepara uma lista com as tabelas selecionadas e o nome do arquivo de destino do Excel queescolhido para transferência dos dados das mesmas
# note: Separa a lista de entrada em duas, sendo cada uma correspondente ao item da posição 0 e da posição 1.
code_block_5 = CodeBlock(out=multipleinputform.User_Inputs) { sched = out[0]; path  = out[1]; }
# note: Obtém o nome da planilha
name_3 = Element.Name(element=code_block_5.sched)
code_block_6 = CodeBlock { false; }
# note: Custom Node: BimorphNodes v.3.0.3
# Obtém os dados da planilha
getData = Revit.Schedule.GetData(scheduleView=code_block_5.sched, refresh=code_block_6)

# note: Força a substituição dos dados na planilha do excel a cada execução pelo nó segunte
code_block_7 = CodeBlock { true; }

# group: Exporta dados para o Excel
# Exporta os dados de cada planilha para uma folha/sheet especíca no arquivo do Excel selecionado e informa sua conclusão ao final da execução
# note: Define parâmetros de configuração
code_block_8 = CodeBlock { "Concluído"; "Exportação de dados das planilhas selecionadas criadas no arquivo de destino."; }
# note: Exporta dados da tabela para a planilha do Excel de destino definida sobrescrevendo as informaçõs anteriormente existentes na mesma
openXMLExportExcel = Data.OpenXMLExportExcel(filePath=code_block_5.path, sheetName=name_3, data=getData, overWrite=code_block_7)
# note: Custom Node: Crumple v.2021.5.27
# Mostra menagem de conclusão da rotina
uimessenger = Custom[© UIMessenger](title=code_block_8.out0, body=code_block_8.out1, pass=openXMLExportExcel)  # package Crumple; Displays a message box with a title/body and OK/cancel button. If OK is selected, the third input's data will be passed through.
