# Dynamo graph Quantitativo_automatio_por_ambiente.dyn "QuantitativoAutomatioPorAmbiente" (Dynamo 2.17.0.3472)
# Altera a propriedade "Comentários" de dispositivos elétricos inserindo o nome do ambiente em que estão localizados permitindo a geração de  tabelas de quantitativos por ambiente. O arquivo arquitetônico vinculado precisa possuir os "ambientes" devidamente definidos no mesmo para balizar o levantamento dos dispositivos.
# packages: bimorphNodes 5.1.3

# group: Info
# note: Custom Node: BimorphNodesv.5.1.3
# note: Pré-requisitos :
# •  Projeto arquitretônico a ser vinculado ao projeto
# •  Ambientes definidos no projeto arquitetônico
# note: Esta rotina altera a propriedade Comentários dos elementos de determinadas categorias inserindo a identificdação do ambiente correspondente para permitir a criação de tabelas de quantitativos separadas por ambiente
# Podem ser adicionadas categorias extras, desde que criadas novas e adicionadas na lista de categorias a serem tratadas

# group: Obtém os dispositivos relevantes
# note: Seleciona uma categoria de elemento
categories = Categories("OST_FireAlarmDevices")
categories_2 = Categories("OST_CommunicationDevices")
categories_3 = Categories("OST_DataDevices")
# note: Seleciona uma categoria de elementos
categories_4 = Categories("OST_ElectricalFixtures")
categories_5 = Categories("OST_LightingDevices")
categories_6 = Categories("OST_SecurityDevices")
categories_7 = Categories("OST_TelephoneDevices")
categories_8 = Categories("OST_LightingFixtures")
# note: Cria uma lista de categorias de elementos
# Para incluir mais categorias, acrescente mais entradas na lista abaixo
list_create = List.Create(item0=categories, item1=categories_2, item2=categories_3, item3=categories_4, item4=categories_5, item5=categories_6, item6=categories_7, item7=categories_8)
# note: Obtém todos os elementos das categorias da lista do modelo
all_elements_of_category = ElementsOfCategory(Category=list_create)
# note: aplaina as listas de elementos das categorias para transformar as listas separadas de elementos de cada categoria em uma única lista de elementos
flatten = List.Flatten(list=all_elements_of_category)

# group: Obtém os Ambientes do vínculo
# Obtém os ambientes do projeto arquitetonico inserido como vínculo  ao projeto do Revit
# note: Seleciona o vínculo do projeto arquitetônico no projeto aberto do Revit
selecione_o_vínculo_do_projeto = DSModelElementSelection()  # "Selecione o vínculo do projeto arquitetônico"; 1 picked in the model; graph input
# note: Seleciona uma categoria do Revit
categories_9 = Categories("OST_Rooms")

# note: Obtém os elementos vinculados (Link Element) de uma categoria (Ambientes) do documento vinculado ao projeto do revit (Projeto arquitetônico)
ofCategory = Revit.LinkElement.OfCategory(linkInstance=selecione_o_vínculo_do_projeto, category=categories_9)

# group (continued): Obtém os Ambientes do vínculo
# note: Transforma Link Element em Element
element = Revit.LinkElement.Element(linkElement=ofCategory)

# group: Obtém os ambientes válidos
# Seleciona os ambientes do projeto arquitetonico, elimina os ambientes vazios inválidos que porventura existirem e obtém a lista dos ambientes válidos
# note: Obtém os limites/linhas osso (Core Boundary) dos ambientes.
# Se fosse as linhas de acabamento do elemento, seria necessário usar o nó Room.FinishBoundary
coreBoundary = Room.CoreBoundary(room=element)
# note: Verifica se possui elementos vazios na lista para eliminá-los do processamento
isEmpty = List.IsEmpty(list=coreBoundary@L3)
# note: •  Seleciona os elementos vazios dos nâo vazios da lista
# •  Usa elementos da lista que não estão vazios (Out)
filterByBoolMask = List.FilterByBoolMask(list=element, mask=isEmpty)

# group: Obtém as linhas delimitadoras dos ambientes osso
# Obtém os limites osso dos ambientes e cria os polígonos representativos de suas superficies através de suas linhas delimitadoras
# note: •  Obtém novamente os limites osso apenas dos ambientes válidos selecionados
# •  Obtém o conjunto de linhas que formam um polígono representativo de cada superficie dos ambientes válidos selecionados
coreBoundary_2 = Room.CoreBoundary(room=filterByBoolMask.out)
# note: Aplaina a lista de origem para eliminar alguns níveis desnecessários
# •  Ajustado o nivel para @L2
flatten_2 = List.Flatten(list=coreBoundary_2@L2)

# group: Cria as superficies dos ambientes
# Cria as superficies dos ambientes a partir de cada conjunto de linhas delimitadoras recebidas
# note: Força a criaçâo de uma polycurve fechada a partir das linhas recebidas de cada conjunto de itens da lista de ambientes fornecida
byJoinedCurves = PolyCurve.ByJoinedCurves(curves=flatten_2)
# note: Cria superficies dos ambientes a partir das polycurves fechadas fornecidas
byPatch = Surface.ByPatch(closedCurve=byJoinedCurves)

# group: Cria um sólido para cada ambiente
# Cria um sólido a partrir de cada superfície e altura/espessura definidos a partir de cada ambiente crescendo apenas para o lado superior do seu nível base
# note: Obtém a altura de cada ambiente
height = Room.Height(room=filterByBoolMask.out)
# note: Define um valor booleano falso
boolean = BoolSelector(false)
# note: Cria uma espessura (Estrudar) para as superfícies de cada ambiente
thicken = Surface.Thicken(surface=byPatch, thickness=height, both_sides=boolean)

# group: Obtém a localização dos elementos
# Obtém as coordenadas (pontos) de localização de cada elemento da lista
getLocation = Element.GetLocation(element=flatten)

# group: Testa conflitos
# Verifica o conflito dos elementos com os solidos dos ambientes para determinar quais estão em cada ambiente
# note: Necessário alterar o comportamento do nó para pegar todas as combinações das duas listas de entrada paa garantir que cada elemento seja testado em cada ambiente. O comportamento padrão do nó é testar apenas o primeiro elemento de cada lista
# •  Usar a opção Cross Product/Produto Cartesiano ao invés da padrâo na opçâo Lacing/Treliça do nó para forçar o teste de cada elemento de uma lista com cada elemento da outra, no caso, as listas de Ambientes e de Elementos das categorias selecionadas
doesIntersect = Geometry.DoesIntersect(geometry=thicken, other=getLocation, lacing=CrossProduct)

# group: Obtém lista de elementos de cada ambiente
# Gera listas dos elementos que estão dentro de cada ambiente e outra com os elementos que não estão
# note: Gera listas de elementos que estão dentro de cada ambiente e outra com os elementos que não estão baseado na o teste da interseção sobreposiçâo de suas posições no espaço 3D.
# Os elementos que estiverem em um ambiete são os que estarão na lista de interseção com resultado true do teste (in).
# Os demais estarão na lista com resultado de teste booleano false (out)
filterByBoolMask_2 = List.FilterByBoolMask(list=flatten, mask=doesIntersect@L2)

# group: Insere o nome dos ambientes nos elementos
# Ajusta o parâmetro escolhido dos elementos para o nome do ambiente correspondente
# note: Especifica o nome do parâmetro a ser alterado no elemento
string = StringInput("Comentários")
# note: Informa o ambiete
name = Room.Name(room=filterByBoolMask.out)
# note: Ajusta/Altera o valor do parâmetro do elemento
setParameterByName = Element.SetParameterByName(element=filterByBoolMask_2.in, parameterName=string, value=name)
